# Grasshopper definition 03_lattice.gh (Grasshopper 0.9.76)
# plug-ins: Python Interpreter, Millipede

box = DomainBox(Base=PlaneXY(0, 0, 0), X="0 to 90", Y="3 to 43", Z="0 to 90")
boxprop = BoxProperties(Box=box)  # -> Center, Diagonal, Area, Volume, Degeneracy
frepvoxelgrid = FRepVoxelGrid(box=box, dim=Slider(1, range=0..10))  # -> wbox, nx, ny, nz, pts
pt = Point(boxprop.Center)

# ---- group: generate spherical gradient
frepsphere = FRepSphere(center=pt, radius=Slider(30, range=0..100), pts=frepvoxelgrid.pts)  # -> out, a; inputs center: list of Point3d, radius: list, pts: list of Point3d
# ---------- frepsphere: Python ----------
#!/usr/bin/env python2
# -*- coding: utf-8 -*-

__author__     = ['Mathias Bernhard']
__copyright__  = 'Copyright 2018 / Digital Building Technologies DBT / ETH Zurich'
__license__    = 'MIT License'
__email__      = '<bernhard@arch.ethz.ch>'

"""
Creates one or multiple Sphere(s)
If multiple centers and one radius is fed in, all spheres are created with equal radius.
If only one center but multiple radii are fed in, only the biggest sphere is created (others are within).
If multiple centers and multiple radii are fed in, values are matched by index (shorter list).
Inputs:
    center: The center(s) of the sphere(s) (list)
    radius: The radius/radii for the sphere(s) (list)
    pts: List of points to query (list)
Output:
    a: Distance values for all points in pts
"""

import rhinoscriptsyntax as rs

# with multiple centers and only one radius,
# all spheres get the same radius
if len(radius)==1 and len(center)>1:
    radius = [radius[0] for _ in center]

# with only one center and multiple radii,
# only the biggest radius is considered
if len(center)==1 and len(radius)>1:
    radius = [max(radius)]

if len(radius) != len(center):
    num = min(len(radius),len(center))
    radius = radius[:num]
    center = center[:num]

a = [9999 for p in pts]
for i,c in enumerate(center):
    a = [min(a[j],rs.Distance(c,p)-radius[i]) for j,p in enumerate(pts)]
# ---------- end frepsphere ----------
division = Division(A=frepsphere.a, B=Slider(27, range=0..100))

# ---- group: generate gyroid lattice
frepgyroid = FRepGyroid(wavelength=Slider(7.5, range=0..100), pts=frepvoxelgrid.pts)  # -> out, a; inputs pts: list of Point3d
# ---------- frepgyroid: Python ----------
#!/usr/bin/env python2
# -*- coding: utf-8 -*-

__author__     = ['Mathias Bernhard']
__copyright__  = 'Copyright 2018 / Digital Building Technologies DBT / ETH Zurich'
__license__    = 'MIT License'
__email__      = '<bernhard@arch.ethz.ch>'

import rhinoscriptsyntax as rs
import math

fact = wavelength/math.pi
def get_dist(p):
    return math.sin(p[0]/fact)*math.cos(p[1]/fact) + math.sin(p[1]/fact)*math.cos(p[2]/fact) + math.sin(p[2]/fact)*math.cos(p[0]/fact)
    
a = [get_dist(p) for p in pts]
# ---------- end frepgyroid ----------

# ---- group: add gradient to lattice for offset
addition = Addition(A=frepgyroid.a, B=division)

# ---- group: intersect with box for closed borders
pl = PlaneNormal(Origin=pt, ZAxis=Vector(0, 0, 1))
frepbox = FRepBox(origin=pl, L="88", W="38", H="88", pts=frepvoxelgrid.pts)  # -> out, a; inputs origin: list of Plane, pts: list of Point3d
# ---------- frepbox: Python ----------
#!/usr/bin/env python2
# -*- coding: utf-8 -*-

"""
Creates a Box
Inputs:
    origin: The origin (plane) of the torus (list)
    L: the length of the box along X (float)
    W: the width of the box along Y (float)
    H: the height of the box along Z (float)
    fillet_radius: optional fillet radius for the edges (float)
    pts: List of points to query (list)
Output:
    a: Distance values for all points in pts
"""

__author__     = ['Mathias Bernhard']
__copyright__  = 'Copyright 2018 / Digital Building Technologies DBT / ETH Zurich'
__license__    = 'MIT License'
__email__      = '<bernhard@arch.ethz.ch>'

import rhinoscriptsyntax as rs
import Rhino.Geometry as rg
import math

def get_dist(p,o):
    dx = abs(p.X-o.OriginX) - (L/2-fillet_radius)
    dy = abs(p.Y-o.OriginY) - (W/2-fillet_radius)
    dz = abs(p.Z-o.OriginZ) - (H/2-fillet_radius)
    inside = max(dx,max(dy,dz)) - fillet_radius
    dx = max(dx,0)
    dy = max(dy,0)
    dz = max(dz,0)
    corner = math.pow(dx*dx + dy*dy + dz*dz,0.5) - fillet_radius
    if inside+fillet_radius>0:
        return corner
    else:
        return inside

# set default values
if not L:
    L=5
if not W:
    W=4
if not H:
    H=3
if not fillet_radius:
    fillet_radius = 0

a = [9999.9 for p in pts]
# calculate transformation matrix between worldxy and box plane
voxplane = rs.WorldXYPlane()
for o in origin:
    tpts = [rg.Point3d(p) for p in pts]
    voxplane.Origin = o.Origin
    tf = rg.Transform.PlaneToPlane(o,voxplane)
    
    # rebase the points according to the transformation matrix
    for p in tpts:
        p.Transform(tf)
    
    a = [min(a[j],get_dist(p,o)) for j,p in enumerate(tpts)]
# ---------- end frepbox ----------
frepintersection = FRepIntersection(A=addition, B=frepbox.a)  # -> out, a; inputs A: list, B: list
# ---------- frepintersection: Python ----------
#!/usr/bin/env python2
# -*- coding: utf-8 -*-

__author__     = ['Mathias Bernhard']
__copyright__  = 'Copyright 2018 / Digital Building Technologies DBT / ETH Zurich'
__license__    = 'MIT License'
__email__      = '<bernhard@arch.ethz.ch>'

a = [max(t) for t in zip(A,B)]
# ---------- end frepintersection ----------

# ----
iso_surface = IsoSurface(
    Box=frepvoxelgrid.wbox,
    Values=frepintersection.a,
    XResolution=frepvoxelgrid.nx,
    YResolution=frepvoxelgrid.ny,
    ZResolution=frepvoxelgrid.nz,
    IsoValue=0,
    MergeVertices=True)
preview = CustomPreview(Geometry=iso_surface, Shader=ColourSwatch(SwatchColor=RGB(252, 108, 133)))

# ==== cluster FRepVoxelGrid: Creates the initial grid of voxels. Outputs number of cells in X, Y and Z and a list of query points.
box = ClusterInput()
box_corners = BoxCorners(Box=box)  # -> CornerA, CornerB, CornerC, CornerD, CornerE, CornerF, CornerG, CornerH
bbox = BoundingBox(
    Content=[box_corners.CornerA, box_corners.CornerB, box_corners.CornerC, box_corners.CornerD, box_corners.CornerE, box_corners.CornerF, box_corners.CornerG, box_corners.CornerH],
    Plane=PlaneXY(0, 0, 0),
    UnionBox=True)  # -> wBox, B
dim = ClusterInput()
c_script = CSharpScript(Box=bbox.wBox, dim=dim)  # -> out, nx, ny, nz, pts; inputs Box: Box, dim: Double
# ---------- c_script: C# ----------
    double dx = Box.X[1] - Box.X[0];
    double dy = Box.Y[1] - Box.Y[0];
    double dz = Box.Z[1] - Box.Z[0];

    int nxt = (int) Math.Round(dx / dim);
    int nyt = (int) Math.Round(dy / dim);
    int nzt = (int) Math.Round(dz / dim);
    
    double dimx = dx / nxt;
    double dimy = dy / nyt;
    double dimz = dz / nzt;

    nx = nxt;
    ny = nyt;
    nz = nzt;

    Point3d[] res = new Point3d[nxt * nyt * nzt];
    int i = 0;
    for (int z = 0; z < nzt; z++) {
      for (int y = 0; y < nyt; y++) {
        for (int x = 0; x < nxt; x++) {
          double px = dimx / 2 + Box.Center[0] - dx / 2 + x * dimx;
          double py = dimy / 2 + Box.Center[1] - dy / 2 + y * dimy;
          double pz = dimz / 2 + Box.Center[2] - dz / 2 + z * dimz;
          res[i] = new Point3d(px, py, pz);
          i++;
        }
      }
    }
    pts = res;
# ---------- c_script: C# additional code ----------
  /*
  #!/usr/bin/env python2
  # -*- coding: utf-8 -*-

  __author__     = ['Mathias Bernhard']
  __copyright__  = 'Copyright 2018 / Digital Building Technologies DBT / ETH Zurich'
  __license__    = 'MIT License'
  __email__      = '<bernhard@arch.ethz.ch>'

  import rhinoscriptsyntax as rs

  dx = Box.X[1]-Box.X[0]
  dy = Box.Y[1]-Box.Y[0]
  dz = Box.Z[1]-Box.Z[0]

  nx = int(dx/dim)+1
  ny = int(dy/dim)+1
  nz = int(dz/dim)+1

  pts = []
  for z in range(nz):
  for y in range(ny):
  for x in range(nx):
  px = dim/2 + Box.Center[0]-dx/2 + x*dim
  py = dim/2 + Box.Center[1]-dy/2 + y*dim
  pz = dim/2 + Box.Center[2]-dz/2 + z*dim
  pts.append(rs.AddPoint(px,py,pz))

  */

  /// <summary>
  /// This method will be called once every solution, before any calls to RunScript.
  /// </summary>
  public override void BeforeRunScript()
  { }
  /// <summary>
  /// This method will be called once every solution, after any calls to RunScript.
  /// </summary>
  public override void AfterRunScript()
  { }
# ---------- end c_script ----------
wbox = ClusterOutput(bbox.wBox)
nx = ClusterOutput(c_script.nx)
ny = ClusterOutput(c_script.ny)
nz = ClusterOutput(c_script.nz)
pts = ClusterOutput(c_script.pts)
